# Grasshopper definition human_arm.end-bands-15mm.gh (Grasshopper 1.0.8)

length = Slider(250, range=0..1000)
yz_plane = YZPlane(Origin=Point(0, 0, 0))
radius_large = Slider(62, range=0..100)
radius_small = Slider(35, range=0..100)
circle = Circle(Plane=yz_plane, Radius=radius_small)
circle_2 = Circle(Plane=yz_plane, Radius=radius_large)
unit_x = UnitX(Factor=length)
move = Move(Geometry=circle_2, Motion=unit_x)  # -> Geometry, Transform
merge = Merge(Data1=circle, Data2=move.Geometry)
loft = Loft(Curves=merge, Options={Adjust=False, Closed=False, LoftEnds=0, LoftSimp=0, LoftType=0, Rebuild=10, Refit=0.01})
grid_count = Slider(12, range=0..40)
grid_count_2 = Slider(12, range=0..40)
divide_curve = DivideCurve(Curve=move.Geometry, Count=grid_count_2, Kinks=False)  # -> Points, Tangents, Parameters
divide_curve_2 = DivideCurve(Curve=circle, Count=grid_count, Kinks=False)  # -> Points, Tangents, Parameters
weave_shift = Slider(4, range=0..10)
weave_shift_2 = Slider(-4, range=-10..0)
shift_list = ShiftList(List=divide_curve.Points, Shift=weave_shift, Wrap=Toggle(True))
shift_list_2 = ShiftList(List=divide_curve.Points, Shift=weave_shift_2, Wrap=Toggle(True))
line = Line(StartPoint=divide_curve_2.Points, EndPoint=shift_list)
vector_2pt = Vector2Pt(PointA=divide_curve_2.Points, PointB=shift_list_2, Unitize=False)  # -> Vector, Length; disabled
vector_2pt_2 = Vector2Pt(PointA=divide_curve_2.Points, PointB=shift_list, Unitize=False)  # -> Vector, Length; disabled
line_2 = Line(StartPoint=divide_curve_2.Points, EndPoint=shift_list_2)
pull_curve = PullCurve(Curve=line_2, Surface=loft)
pull_curve_2 = PullCurve(Curve=line, Surface=loft)
strip_width = Slider(4, range=0..30)
strip_width_2 = Slider(2, range=0..30)
strip_width_3 = Slider(2, range=0..30)
strip_width_4 = Slider(4, range=0..30)
division = Division(A=strip_width_4, B=strip_width_3)
division_2 = Division(A=strip_width, B=strip_width_2)
cross_reference = CrossReference(ListListA=flatten(pull_curve_2), ListListB=flatten(pull_curve), CrossMode=1)  # -> ListListA, ListListB
negative = Negative(Value=division)
negative_2 = Negative(Value=division_2)
curve_curve = CurveCurve(CurveA=cross_reference.ListListA, CurveB=cross_reference.ListListB)  # -> Points, ParamsA, ParamsB
offset_on_srf = OffsetOnSrf(Curve=pull_curve_2, Distance=division_2, Surface=loft)
offset_on_srf_2 = OffsetOnSrf(Curve=pull_curve, Distance=division, Surface=loft)
offset_on_srf_3 = OffsetOnSrf(Curve=pull_curve_2, Distance=negative_2, Surface=loft)
offset_on_srf_4 = OffsetOnSrf(Curve=pull_curve, Distance=negative, Surface=loft)
intersectionpoints = Point(flatten(curve_curve.Points))
list_length = ListLength(List=intersectionpoints)
merge_2 = Merge(Data1=offset_on_srf_2, Data2=offset_on_srf_4)  # -> simplify(Result)
merge_3 = Merge(Data1=offset_on_srf_3, Data2=offset_on_srf)  # -> simplify(Result)
curve_closest_point = CurveClosestPoint(Point=intersectionpoints, Curve=circle)  # -> Point, Parameter, Distance
panel = Panel(list_length)
panel_2 = Panel(merge_3)
loft_2 = Loft(Curves=merge_2, Options={Adjust=False, Closed=False, LoftEnds=0, LoftSimp=0, LoftType=0, Rebuild=10, Refit=0.01})
loft_3 = Loft(Curves=merge_3, Options={Adjust=False, Closed=False, LoftEnds=0, LoftSimp=0, LoftType=0, Rebuild=10, Refit=0.01})
strip_thickness = Slider(0.2, range=0..5)
larger_than = LargerThan(FirstNumber=curve_closest_point.Distance, SecondNumber=Slider(0.01, range=0..1))  # -> LargerThan, OrEqualTo
dispatch = Dispatch(List=intersectionpoints, DispatchPattern=larger_than.LargerThan)  # -> ListA, ListB
offset_surface = OffsetSurface(Surface=[loft_2, loft_3], Distance=strip_thickness, Retrim=True)
rotate_integer_slider = Slider(0, range=0..1)
height_number_slider = Slider(25, range=0..40)
offset_number_slider = Slider(0.2, range=0..1)
repeat_data = RepeatData(Data=Slider(0.3, range=0..1), Length=Slider(96, range=0..100))
merge_4 = Merge(Data1=loft_3, Data2=loft_2)
sensorintersections = Point(dispatch.ListA)
end_band_width_mm = Slider(15, range=1..50)
sensor_heatmap = Python3Script(
    Values=flatten(repeat_data),
    Radius=height_number_slider,
    Offset=offset_number_slider,
    Rotate=rotate_integer_slider,
    FlipU=Toggle(False),
    FlipV=Toggle(False),
    Points=flatten(sensorintersections),
    Strips=flatten(offset_surface),
    MeshSize=Slider(3, range=0..10),
    RowCurves=flatten(pull_curve_2),
    ColumnCurves=flatten(pull_curve),
    EndBandWidth=end_band_width_mm)  # -> Status, HeatMesh; inputs Values: list of Double, Radius: Double, Offset: Double, Rotate: Int32, FlipU: Boolean, FlipV: Boolean, Points: list of Point3d, Strips: list of Brep, MeshSize: Double, RowCurves: list of Curve, ColumnCurves: list of Curve
# ---------- sensor_heatmap: Python ----------
import math
import Rhino.Geometry as rg
from System.Drawing import Color

ROWS = 12
COLUMNS = 8
SENSOR_COUNT = 96


def clamp01(value):
    return max(0.0, min(1.0, float(value)))


def heat_color(value):
    value = clamp01(value)

    color_stops = (
        (0.00, (20, 30, 110)),
        (0.25, (0, 170, 255)),
        (0.50, (30, 220, 120)),
        (0.75, (255, 220, 0)),
        (1.00, (230, 30, 20)),
    )

    for index in range(len(color_stops) - 1):
        start_t, start_color = color_stops[index]
        end_t, end_color = color_stops[index + 1]

        if value <= end_t:
            amount = (value - start_t) / (end_t - start_t)

            rgb = tuple(
                int(round(start + (end - start) * amount))
                for start, end in zip(start_color, end_color)
            )

            return Color.FromArgb(*rgb)

    return Color.FromArgb(*color_stops[-1][1])


def convert_to_brep(geometry):
    if isinstance(geometry, rg.Brep):
        return geometry

    if isinstance(geometry, rg.BrepFace):
        return geometry.DuplicateFace(False)

    if isinstance(geometry, rg.Surface):
        return geometry.ToBrep()

    return None


def order_sensor_points(points):
    points = list(points)

    if len(points) != SENSOR_COUNT:
        raise ValueError(
            "Points must contain exactly 96 intersections. "
            "Received {}.".format(len(points))
        )

    bounding_box = rg.BoundingBox(points)
    tolerance = max(
        0.001,
        bounding_box.Diagonal.Length * 0.0001
    )

    points_by_x = sorted(points, key=lambda point: point.X)
    columns = []

    for point in points_by_x:
        if not columns:
            columns.append([point])
            continue

        average_x = (
            sum(item.X for item in columns[-1])
            / len(columns[-1])
        )

        if abs(point.X - average_x) <= tolerance:
            columns[-1].append(point)
        else:
            columns.append([point])

    if len(columns) != COLUMNS:
        raise ValueError(
            "Expected 8 sensor columns. Found {}.".format(
                len(columns)
            )
        )

    for index, column in enumerate(columns):
        if len(column) != ROWS:
            raise ValueError(
                "Column {} contains {} points instead of 12.".format(
                    index + 1,
                    len(column)
                )
            )

        column.sort(
            key=lambda point: math.atan2(point.Z, point.Y)
        )

    return [
        columns[column][row]
        for row in range(ROWS)
        for column in range(COLUMNS)
    ]


def order_sensor_values(values):
    values = [clamp01(value) for value in values]

    if len(values) != SENSOR_COUNT:
        raise ValueError(
            "Values must contain exactly 96 numbers. "
            "Received {}.".format(len(values))
        )

    rotation = int(Rotate or 0) % ROWS
    flip_rows = bool(FlipU)
    flip_columns = bool(FlipV)

    ordered_values = []

    for row in range(ROWS):
        source_row = (row + rotation) % ROWS

        if flip_rows:
            source_row = ROWS - 1 - source_row

        for column in range(COLUMNS):
            source_column = (
                COLUMNS - 1 - column
                if flip_columns
                else column
            )

            source_index = (
                source_row * COLUMNS
                + source_column
            )

            ordered_values.append(values[source_index])

    return ordered_values


def calculate_field_value(
    vertex,
    sensor_points,
    sensor_values,
    radius
):
    strongest_value = 0.0

    for sensor_point, sensor_value in zip(
        sensor_points,
        sensor_values
    ):
        distance = vertex.DistanceTo(sensor_point)

        if distance >= radius:
            continue

        amount = 1.0 - distance / radius

        # Smooth falloff from the sensor center to the edge.
        falloff = amount * amount * (3.0 - 2.0 * amount)
        influence = sensor_value * falloff

        if influence > strongest_value:
            strongest_value = influence

    return clamp01(strongest_value)


try:
    if Strips is None:
        raise ValueError("Strips input is empty.")

    if Points is None:
        raise ValueError("Points input is empty.")

    if Values is None:
        raise ValueError("Values input is empty.")

    sensor_points = order_sensor_points(Points)
    sensor_values = order_sensor_values(Values)

    heat_radius = max(
        0.1,
        float(Radius if Radius is not None else 25.0)
    )

    mesh_edge_size = max(
        0.1,
        float(MeshSize if MeshSize is not None else 3.0)
    )

    preview_offset = float(
        Offset if Offset is not None else 0.0
    )

    meshing_parameters = rg.MeshingParameters()
    meshing_parameters.MaximumEdgeLength = mesh_edge_size
    meshing_parameters.MinimumEdgeLength = mesh_edge_size * 0.25
    meshing_parameters.RefineGrid = True
    meshing_parameters.JaggedSeams = False
    meshing_parameters.SimplePlanes = False

    heat_mesh = rg.Mesh()
    mesh_piece_count = 0

    for geometry in Strips:
        brep = convert_to_brep(geometry)

        if brep is None:
            continue

        mesh_pieces = rg.Mesh.CreateFromBrep(
            brep,
            meshing_parameters
        )

        if not mesh_pieces:
            continue

        for mesh in mesh_pieces:
            if mesh is None or mesh.Vertices.Count == 0:
                continue

            mesh.Normals.ComputeNormals()
            mesh.VertexColors.CreateMonotoneMesh(
                Color.FromArgb(20, 30, 110)
            )

            for vertex_index in range(mesh.Vertices.Count):
                vertex = rg.Point3d(
                    mesh.Vertices[vertex_index]
                )

                field_value = calculate_field_value(
                    vertex,
                    sensor_points,
                    sensor_values,
                    heat_radius
                )

                mesh.VertexColors.SetColor(
                    vertex_index,
                    heat_color(field_value)
                )

                if abs(preview_offset) > 0.000001:
                    normal = rg.Vector3d(
                        mesh.Normals[vertex_index]
                    )

                    moved_vertex = (
                        vertex
                        + normal * preview_offset
                    )

                    mesh.Vertices.SetVertex(
                        vertex_index,
                        moved_vertex.X,
                        moved_vertex.Y,
                        moved_vertex.Z
                    )

            mesh.Normals.ComputeNormals()
            heat_mesh.Append(mesh)
            mesh_piece_count += 1

    heat_mesh.Compact()

    if heat_mesh.Vertices.Count == 0:
        raise ValueError(
            "No mesh could be generated from the strip surfaces."
        )

    # The actual Grasshopper output variable is named "out".
    HeatMesh = heat_mesh

    Status = (
        "OK - strip heatmap | "
        "{} sensor points | "
        "{} mesh pieces | "
        "{} vertices"
    ).format(
        len(sensor_points),
        mesh_piece_count,
        heat_mesh.Vertices.Count
    )

except Exception as error:
    HeatMesh = None
    Status = "ERROR - {}".format(error)

# HUMAN_ARM_END_BANDS_V1
if HeatMesh is not None:
    band_width = float(EndBandWidth)
    end_points = []
    for curve in RowCurves:
        cv = getattr(curve, 'Value', curve)
        end_points.extend([cv.PointAtStart, cv.PointAtEnd])
    x0 = min(p.X for p in end_points)
    x1 = max(p.X for p in end_points)
    ra = sum(math.hypot(p.Y,p.Z) for p in end_points if abs(p.X-x0)<0.01) / sum(1 for p in end_points if abs(p.X-x0)<0.01)
    rb = sum(math.hypot(p.Y,p.Z) for p in end_points if abs(p.X-x1)<0.01) / sum(1 for p in end_points if abs(p.X-x1)<0.01)
    assert 0 < band_width < (x1-x0)/2
    for start, end in [(x0,x0+band_width),(x1-band_width,x1)]:
        band = rg.Mesh()
        segments=192
        # Four circular edges form a closed 0.2-mm-thick tapered ribbon.
        for x, inset in [(start,0),(end,0),(start,0.2),(end,0.2)]:
            radius = ra+(rb-ra)*(x-x0)/(x1-x0)+0.3-inset
            for i in range(segments):
                theta=2*math.pi*i/segments
                band.Vertices.Add(x,radius*math.cos(theta),radius*math.sin(theta))
        for i in range(segments):
            j=(i+1)%segments
            band.Faces.AddFace(i,j,segments+j,segments+i)
            band.Faces.AddFace(2*segments+i,3*segments+i,3*segments+j,2*segments+j)
            band.Faces.AddFace(i,2*segments+i,2*segments+j,j)
            band.Faces.AddFace(segments+i,segments+j,3*segments+j,3*segments+i)
        band.Normals.ComputeNormals()
        for vi in range(band.Vertices.Count):
            vertex=rg.Point3d(band.Vertices[vi])
            band.VertexColors.Add(heat_color(calculate_field_value(vertex,sensor_points,sensor_values,heat_radius)))
        HeatMesh.Append(band)
    HeatMesh.Normals.ComputeNormals()
    HeatMesh.Compact()
    Status += ' | two %.1f mm end bands' % band_width
# ---------- end sensor_heatmap ----------
list_length_2 = ListLength(List=sensorintersections)
panel_3 = Panel(list_length_2)
heatmapmesh = Mesh(sensor_heatmap.HeatMesh)
panel_4 = Panel(sensor_heatmap.Status)
