# Grasshopper definition ring.gh (Grasshopper 1.0.8)

length = Slider(27, range=0..1000)
yz_plane = YZPlane(Origin=Point(0, 0, 0))
radius_large = Slider(9, range=0..100)
radius_small = Slider(8.5, range=0..100)
circle = Circle(Plane=yz_plane, Radius=radius_small)
circle_2 = Circle(Plane=yz_plane, Radius=radius_large)
unit_x = UnitX(Factor=length)
move = Move(Geometry=circle_2, Motion=unit_x)  # -> Geometry, Transform
merge = Merge(Data1=circle, Data2=move.Geometry)
loft = Loft(Curves=merge, Options={Adjust=False, Closed=False, LoftEnds=0, LoftSimp=0, LoftType=0, Rebuild=10, Refit=0.01})
grid_count = Slider(10, range=0..40)
grid_count_2 = Slider(10, range=0..40)
divide_curve = DivideCurve(Curve=move.Geometry, Count=grid_count_2, Kinks=False)  # -> Points, Tangents, Parameters
divide_curve_2 = DivideCurve(Curve=circle, Count=grid_count, Kinks=False)  # -> Points, Tangents, Parameters
weave_shift = Slider(2, range=0..10)
weave_shift_2 = Slider(-2, range=-10..0)
shift_list = ShiftList(List=divide_curve.Points, Shift=weave_shift, Wrap=Toggle(True))
shift_list_2 = ShiftList(List=divide_curve.Points, Shift=weave_shift_2, Wrap=Toggle(True))
line = Line(StartPoint=divide_curve_2.Points, EndPoint=shift_list)
vector_2pt = Vector2Pt(PointA=divide_curve_2.Points, PointB=shift_list_2, Unitize=False)  # -> Vector, Length; disabled
vector_2pt_2 = Vector2Pt(PointA=divide_curve_2.Points, PointB=shift_list, Unitize=False)  # -> Vector, Length; disabled
line_2 = Line(StartPoint=divide_curve_2.Points, EndPoint=shift_list_2)
pull_curve = PullCurve(Curve=line_2, Surface=loft)
pull_curve_2 = PullCurve(Curve=line, Surface=loft)
strip_width = Slider(3, range=0..30)
strip_width_2 = Slider(2, range=0..30)
strip_width_3 = Slider(2, range=0..30)
strip_width_4 = Slider(3, range=0..30)
division = Division(A=strip_width_4, B=strip_width_3)
division_2 = Division(A=strip_width, B=strip_width_2)
cross_reference = CrossReference(ListListA=flatten(pull_curve_2), ListListB=flatten(pull_curve), CrossMode=1)  # -> ListListA, ListListB
negative = Negative(Value=division)
negative_2 = Negative(Value=division_2)
curve_curve = CurveCurve(CurveA=cross_reference.ListListA, CurveB=cross_reference.ListListB)  # -> Points, ParamsA, ParamsB
offset_on_srf = OffsetOnSrf(Curve=pull_curve_2, Distance=division_2, Surface=loft)
offset_on_srf_2 = OffsetOnSrf(Curve=pull_curve, Distance=division, Surface=loft)
offset_on_srf_3 = OffsetOnSrf(Curve=pull_curve_2, Distance=negative_2, Surface=loft)
offset_on_srf_4 = OffsetOnSrf(Curve=pull_curve, Distance=negative, Surface=loft)
intersectionpoints = Point(flatten(curve_curve.Points))
list_length = ListLength(List=intersectionpoints)
merge_2 = Merge(Data1=offset_on_srf_2, Data2=offset_on_srf_4)  # -> simplify(Result)
merge_3 = Merge(Data1=offset_on_srf_3, Data2=offset_on_srf)  # -> simplify(Result)
curve_closest_point = CurveClosestPoint(Point=intersectionpoints, Curve=circle)  # -> Point, Parameter, Distance
panel = Panel(list_length)
panel_2 = Panel(merge_3)
loft_2 = Loft(Curves=merge_2, Options={Adjust=False, Closed=False, LoftEnds=0, LoftSimp=0, LoftType=0, Rebuild=10, Refit=0.01})
number_slider = Slider(0.01, range=0..1)
loft_3 = Loft(Curves=merge_3, Options={Adjust=False, Closed=False, LoftEnds=0, LoftSimp=0, LoftType=0, Rebuild=10, Refit=0.01})
strip_thickness = Slider(0.2, range=0..5)
larger_than = LargerThan(FirstNumber=curve_closest_point.Distance, SecondNumber=number_slider)  # -> LargerThan, OrEqualTo
dispatch = Dispatch(List=intersectionpoints, DispatchPattern=larger_than.LargerThan)  # -> ListA, ListB
exclude_right_boundary = CurveClosestPoint(Point=dispatch.ListA, Curve=move.Geometry)  # -> Point, Parameter, Distance
larger = LargerThan(FirstNumber=exclude_right_boundary.Distance, SecondNumber=number_slider)  # -> LargerThan, OrEqualTo
offset_surface = OffsetSurface(Surface=[loft_2, loft_3], Distance=strip_thickness, Retrim=True)
dispatch_2 = Dispatch(List=dispatch.ListA, DispatchPattern=larger.LargerThan)  # -> ListA, ListB
rotate_integer_slider = Slider(0, range=0..1)
heat_radius_mm = Slider(3, range=0..40)
offset_number_slider = Slider(0.1, range=0..1)
repeat_data = RepeatData(Data=Slider(0.3, range=0..1), Length=Slider(30, range=0..100))
heat_mesh_size_mm = Slider(0.6, range=0.2..10)
merge_4 = Merge(Data1=loft_3, Data2=loft_2)
sensorintersections = Point(dispatch_2.ListA)
boolean_toggle = BooleanToggle(False)
boolean_toggle_2 = BooleanToggle(False)
end_band_width_mm = Slider(3, range=0.5..10)
sensor_heatmap = Python3Script(
    Values=flatten(repeat_data),
    Radius=heat_radius_mm,
    Offset=offset_number_slider,
    Rotate=rotate_integer_slider,
    Points=flatten(sensorintersections),
    Strips=flatten(offset_surface),
    MeshSize=heat_mesh_size_mm,
    EndBandWidth=end_band_width_mm,
    EndBandLength=length,
    EndBandFrontRadius=radius_small,
    EndBandRearRadius=radius_large)  # -> Status, HeatMesh; inputs Values: list of Double, Radius: Double, Offset: Double, Rotate: Int32, Points: list of Point3d, Strips: list of Brep, MeshSize: Double
# ---------- sensor_heatmap: Python ----------
import Rhino.Geometry as rg
from System.Drawing import Color


SENSOR_COUNT = 30


def clamp01(value):
    return max(0.0, min(1.0, float(value)))


def heat_color(value):
    value = clamp01(value)

    color_stops = (
        (0.00, (20, 30, 110)),
        (0.25, (0, 170, 255)),
        (0.50, (30, 220, 120)),
        (0.75, (255, 220, 0)),
        (1.00, (230, 30, 20)),
    )

    for index in range(len(color_stops) - 1):
        start_t, start_color = color_stops[index]
        end_t, end_color = color_stops[index + 1]

        if value <= end_t:
            amount = (value - start_t) / (end_t - start_t)

            rgb = tuple(
                int(round(start + (end - start) * amount))
                for start, end in zip(start_color, end_color)
            )

            return Color.FromArgb(*rgb)

    return Color.FromArgb(*color_stops[-1][1])


def convert_to_brep(geometry):
    if isinstance(geometry, rg.Brep):
        return geometry

    if isinstance(geometry, rg.BrepFace):
        return geometry.DuplicateFace(False)

    if isinstance(geometry, rg.Surface):
        return geometry.ToBrep()

    return None


def order_sensor_points(points):
    points = list(points)

    if len(points) != SENSOR_COUNT:
        raise ValueError(
            "Sensor points must contain exactly 30 crossing points. "
            "Received {}.".format(len(points))
        )

    # 这里只接收真正的 30 个交叉点
    # 两侧圆环上的 20 个节点不属于传感器
    return points


def order_sensor_values(values):
    values = [clamp01(value) for value in values]

    if len(values) != SENSOR_COUNT:
        raise ValueError(
            "Sensor values must contain exactly 30 values. "
            "Received {}.".format(len(values))
        )

    return values


def calculate_field_value(
    vertex,
    sensor_points,
    sensor_values,
    radius
):
    strongest_value = 0.0

    for sensor_point, sensor_value in zip(
        sensor_points,
        sensor_values
    ):
        distance = vertex.DistanceTo(sensor_point)

        if distance >= radius:
            continue

        amount = 1.0 - distance / radius

        # 平滑衰减
        falloff = amount * amount * (3.0 - 2.0 * amount)
        influence = sensor_value * falloff

        if influence > strongest_value:
            strongest_value = influence

    return clamp01(strongest_value)


try:
    if Strips is None:
        raise ValueError("Strips input is empty.")

    if Points is None:
        raise ValueError("Points input is empty.")

    if Values is None:
        raise ValueError("Values input is empty.")

    sensor_points = order_sensor_points(Points)
    sensor_values = order_sensor_values(Values)

    heat_radius = max(
        0.1,
        float(Radius if Radius is not None else 25.0)
    )

    mesh_edge_size = max(
        0.1,
        float(MeshSize if MeshSize is not None else 3.0)
    )

    preview_offset = float(
        Offset if Offset is not None else 0.0
    )

    meshing_parameters = rg.MeshingParameters()
    meshing_parameters.MaximumEdgeLength = mesh_edge_size
    meshing_parameters.MinimumEdgeLength = mesh_edge_size * 0.25
    meshing_parameters.RefineGrid = True
    meshing_parameters.JaggedSeams = False
    meshing_parameters.SimplePlanes = False

    heat_mesh = rg.Mesh()
    mesh_piece_count = 0

    for geometry in Strips:
        brep = convert_to_brep(geometry)

        if brep is None:
            continue

        mesh_pieces = rg.Mesh.CreateFromBrep(
            brep,
            meshing_parameters
        )

        if not mesh_pieces:
            continue

        for mesh in mesh_pieces:
            if mesh is None:
                continue

            if mesh.Vertices.Count == 0:
                continue

            mesh.Normals.ComputeNormals()

            mesh.VertexColors.CreateMonotoneMesh(
                Color.FromArgb(20, 30, 110)
            )

            for vertex_index in range(mesh.Vertices.Count):
                vertex = rg.Point3d(
                    mesh.Vertices[vertex_index]
                )

                field_value = calculate_field_value(
                    vertex,
                    sensor_points,
                    sensor_values,
                    heat_radius
                )

                mesh.VertexColors.SetColor(
                    vertex_index,
                    heat_color(field_value)
                )

                if abs(preview_offset) > 0.000001:
                    normal = rg.Vector3d(
                        mesh.Normals[vertex_index]
                    )

                    moved_vertex = vertex + normal * preview_offset

                    mesh.Vertices.SetVertex(
                        vertex_index,
                        moved_vertex.X,
                        moved_vertex.Y,
                        moved_vertex.Z
                    )

            mesh.Normals.ComputeNormals()
            heat_mesh.Append(mesh)
            mesh_piece_count += 1

    heat_mesh.Compact()

    if heat_mesh.Vertices.Count == 0:
        raise ValueError(
            "No mesh could be generated from the strip surfaces."
        )

    HeatMesh = heat_mesh

    Status = (
        "OK - Ring heatmap | "
        "{} sensor crossing points | "
        "{} mesh pieces | "
        "{} vertices"
    ).format(
        len(sensor_points),
        mesh_piece_count,
        heat_mesh.Vertices.Count
    )

except Exception as error:
    HeatMesh = None
    Status = "ERROR - {}".format(error)
    
bl=float(EndBandLength);br0=float(EndBandFrontRadius);br1=float(EndBandRearRadius)

# ROBOT_FINGER_END_BANDS_V1
import math
if HeatMesh is not None:
    bw = float(EndBandWidth)
    assert 0 < bw < bl / 2
    band_start_vertex = HeatMesh.Vertices.Count
    for start, end in [(0,bw),(bl-bw,bl)]:
        band = rg.Mesh()
        segments = 192
        for x, inset in [(start,0),(end,0),(start,0.2),(end,0.2)]:
            radius = br0+(br1-br0)*x/bl+0.3-inset
            for i in range(segments):
                angle = 2*math.pi*i/segments
                band.Vertices.Add(x,radius*math.cos(angle),radius*math.sin(angle))
        for i in range(segments):
            j=(i+1)%segments
            band.Faces.AddFace(i,j,segments+j,segments+i)
            band.Faces.AddFace(2*segments+i,3*segments+i,3*segments+j,2*segments+j)
            band.Faces.AddFace(i,2*segments+i,2*segments+j,j)
            band.Faces.AddFace(segments+i,segments+j,3*segments+j,3*segments+i)
        band.Normals.ComputeNormals()
        for i in range(band.Vertices.Count):
            band.VertexColors.Add(heat_color(calculate_field_value(rg.Point3d(band.Vertices[i]),sensor_points,sensor_values,heat_radius)))
        HeatMesh.Append(band)
    HeatMesh.Normals.ComputeNormals()
    HeatMesh.Compact()
    Status += ' | two %.1f mm end bands' % bw
# ---------- end sensor_heatmap ----------
list_length_2 = ListLength(List=sensorintersections)
panel_3 = Panel(list_length_2)
heatmapmesh = Mesh(sensor_heatmap.HeatMesh)
panel_4 = Panel(sensor_heatmap.Status)
