# Grasshopper definition human_arm_woven.gh (Grasshopper 1.0.8)

weavelift_mm = Slider(0.8, range=0.1..3)
stripthickness_mm = Slider(0.4, range=0.1..2)
stripwidth_mm = Slider(4, range=1..8)
length = Slider(250, range=0..1000)
yz_plane = YZPlane(Origin=Point(0, 0, 0))
radius_large = Slider(62, range=0..100)
radius_small = Slider(35, range=0..100)
circle = Circle(Plane=yz_plane, Radius=radius_small)
circle_2 = Circle(Plane=yz_plane, Radius=radius_large)
unit_x = UnitX(Factor=length)
move = Move(Geometry=circle_2, Motion=unit_x)  # -> Geometry, Transform
merge = Merge(Data1=circle, Data2=move.Geometry)
loft = Loft(Curves=merge, Options={Adjust=False, Closed=False, LoftEnds=0, LoftSimp=0, LoftType=0, Rebuild=10, Refit=0.01})
grid_count = Slider(12, range=0..40)
grid_count_2 = Slider(12, range=0..40)
divide_curve = DivideCurve(Curve=move.Geometry, Count=grid_count_2, Kinks=False)  # -> Points, Tangents, Parameters
divide_curve_2 = DivideCurve(Curve=circle, Count=grid_count, Kinks=False)  # -> Points, Tangents, Parameters
weave_shift = Slider(4, range=0..10)
weave_shift_2 = Slider(-4, range=-10..0)
shift_list = ShiftList(List=divide_curve.Points, Shift=weave_shift, Wrap=Toggle(True))
shift_list_2 = ShiftList(List=divide_curve.Points, Shift=weave_shift_2, Wrap=Toggle(True))
line = Line(StartPoint=divide_curve_2.Points, EndPoint=shift_list)
vector_2pt = Vector2Pt(PointA=divide_curve_2.Points, PointB=shift_list_2, Unitize=False)  # -> Vector, Length; disabled
vector_2pt_2 = Vector2Pt(PointA=divide_curve_2.Points, PointB=shift_list, Unitize=False)  # -> Vector, Length; disabled
line_2 = Line(StartPoint=divide_curve_2.Points, EndPoint=shift_list_2)
pull_curve = PullCurve(Curve=line_2, Surface=loft)
pull_curve_2 = PullCurve(Curve=line, Surface=loft)
strip_width = Slider(4, range=0..30)
strip_width_2 = Slider(2, range=0..30)
strip_width_3 = Slider(2, range=0..30)
strip_width_4 = Slider(4, range=0..30)
division = Division(A=strip_width_4, B=strip_width_3)
division_2 = Division(A=strip_width, B=strip_width_2)
cross_reference = CrossReference(ListListA=flatten(pull_curve_2), ListListB=flatten(pull_curve), CrossMode=1)  # -> ListListA, ListListB
negative = Negative(Value=division)
negative_2 = Negative(Value=division_2)
curve_curve = CurveCurve(CurveA=cross_reference.ListListA, CurveB=cross_reference.ListListB)  # -> Points, ParamsA, ParamsB
offset_on_srf = OffsetOnSrf(Curve=pull_curve_2, Distance=division_2, Surface=loft)
offset_on_srf_2 = OffsetOnSrf(Curve=pull_curve, Distance=division, Surface=loft)
offset_on_srf_3 = OffsetOnSrf(Curve=pull_curve_2, Distance=negative_2, Surface=loft)
offset_on_srf_4 = OffsetOnSrf(Curve=pull_curve, Distance=negative, Surface=loft)
intersectionpoints = Point(flatten(curve_curve.Points))
list_length = ListLength(List=intersectionpoints)
merge_2 = Merge(Data1=offset_on_srf_2, Data2=offset_on_srf_4)  # -> simplify(Result)
merge_3 = Merge(Data1=offset_on_srf_3, Data2=offset_on_srf)  # -> simplify(Result)
curve_closest_point = CurveClosestPoint(Point=intersectionpoints, Curve=circle)  # -> Point, Parameter, Distance
panel = Panel(list_length)
panel_2 = Panel(merge_3)
loft_2 = Loft(Curves=merge_2, Options={Adjust=False, Closed=False, LoftEnds=0, LoftSimp=0, LoftType=0, Rebuild=10, Refit=0.01})
loft_3 = Loft(Curves=merge_3, Options={Adjust=False, Closed=False, LoftEnds=0, LoftSimp=0, LoftType=0, Rebuild=10, Refit=0.01})
strip_thickness = Slider(0.2, range=0..5)
larger_than = LargerThan(FirstNumber=curve_closest_point.Distance, SecondNumber=Slider(0.01, range=0..1))  # -> LargerThan, OrEqualTo
dispatch = Dispatch(List=intersectionpoints, DispatchPattern=larger_than.LargerThan)  # -> ListA, ListB
offset_surface = OffsetSurface(Surface=[loft_2, loft_3], Distance=strip_thickness, Retrim=True)
rotate_integer_slider = Slider(0, range=0..1)
height_number_slider = Slider(25, range=0..40)
offset_number_slider = Slider(0.2, range=0..1)
repeat_data = RepeatData(Data=Slider(0.3, range=0..1), Length=Slider(96, range=0..100))
merge_4 = Merge(Data1=loft_3, Data2=loft_2)
sensorintersections = Point(dispatch.ListA)
end_band_width_mm = Slider(5, range=1..50)
sensor_heatmap = Python3Script(
    Values=flatten(repeat_data),
    Radius=height_number_slider,
    Offset=offset_number_slider,
    Rotate=rotate_integer_slider,
    FlipU=Toggle(False),
    FlipV=Toggle(False),
    Points=flatten(sensorintersections),
    Strips=flatten(offset_surface),
    MeshSize=Slider(3, range=0..10),
    RowCurves=flatten(pull_curve_2),
    ColumnCurves=flatten(pull_curve),
    EndBandWidth=end_band_width_mm,
    WeaveLift=weavelift_mm,
    StripThickness=stripthickness_mm,
    StripWidth=stripwidth_mm)  # -> Status, HeatMesh; inputs Values: list of Double, Radius: Double, Offset: Double, Rotate: Int32, FlipU: Boolean, FlipV: Boolean, Points: list of Point3d, Strips: list of Brep, MeshSize: Double, RowCurves: list of Curve, ColumnCurves: list of Curve
# ---------- sensor_heatmap: Python ----------
# ARM_PLAIN_WEAVE_V1: closed ribbons following original GH centre curves.
import math
import Rhino.Geometry as rg
from System.Drawing import Color

lift=float(WeaveLift)
thickness=float(StripThickness)
width=float(StripWidth)
curves=[getattr(c,'Value',c) for c in list(RowCurves)+list(ColumnCurves)]
points=[getattr(p,'Value',p) for p in Points]
weave_meshes=[]
weave_checks=[]

def smooth(t):
    t=max(0.,min(1.,t))
    return t*t*t*(10+t*(-15+6*t))

for ci,curve in enumerate(curves):
    # Crossings are sorted geometrically along each strand, including end anchors.
    knots=[]
    for point in points:
        ok,t=curve.ClosestPoint(point)
        if ok and curve.PointAt(t).DistanceTo(point)<.02:
            knots.append((point.X,t))
    knots.sort()
    unique=[]
    for x,t in knots:
        if not unique or abs(x-unique[-1][0])>.02: unique.append((x,t))
    assert len(unique)==8,'Expected eight crossings per strand'
    family=1 if ci<12 else -1
    x0=curve.PointAtStart.X; x1=curve.PointAtEnd.X
    anchors=[(x0,family*lift)]
    for k,(x,t) in enumerate(unique):
        anchors.append((x,family*lift*(-1 if k%2==0 else 1)))
    if anchors[-1][0]<x1-.02: anchors.append((x1,anchors[-1][1]))
    def displacement(x):
        for k in range(len(anchors)-1):
            xa,ha=anchors[k]; xb,hb=anchors[k+1]
            if x<=xb:
                # Flat shoulders over the finite-width crossing; smooth bend between.
                q=(x-xa)/(xb-xa)
                u=smooth((q-.24)/.52)
                return ha+(hb-ha)*u
        return anchors[-1][1]
    mesh=rg.Mesh()
    steps=750
    for i in range(steps+1):
        x=x0+(x1-x0)*i/steps
        lo,hi=curve.Domain.T0,curve.Domain.T1
        for _ in range(32):
            mid=(lo+hi)/2
            if curve.PointAt(mid).X<x: lo=mid
            else: hi=mid
        t=(lo+hi)/2
        p=curve.PointAt(t)
        r=math.hypot(p.Y,p.Z)
        normal=rg.Vector3d(-.108,p.Y/r,p.Z/r);normal.Unitize()
        tangent=curve.TangentAt(t);tangent.Unitize()
        lateral=rg.Vector3d.CrossProduct(normal,tangent);lateral.Unitize()
        h=displacement(x)
        for side,depth in [(-1,-1),(1,-1),(-1,1),(1,1)]:
            q=p+lateral*(side*width/2)+normal*(h+depth*thickness/2)
            mesh.Vertices.Add(q)
    for i in range(steps):
        a=4*i;b=a+4
        mesh.Faces.AddFace(a,a+1,b+1,b)
        mesh.Faces.AddFace(a+2,b+2,b+3,a+3)
        mesh.Faces.AddFace(a,b,b+2,a+2)
        mesh.Faces.AddFace(a+1,a+3,b+3,b+1)
    mesh.Faces.AddFace(0,2,3,1)
    a=4*steps;mesh.Faces.AddFace(a,a+1,a+3,a+2)
    mesh.UnifyNormals();mesh.Normals.ComputeNormals();mesh.Compact()
    if mesh.SolidOrientation()<0: mesh.Flip(True,True,True)
    mesh.VertexColors.CreateMonotoneMesh(Color.FromArgb(20,30,110))
    weave_meshes.append(mesh)
    weave_checks.append({'family':'A' if ci<12 else 'B','index':ci%12,'crossings':len(unique),'heights':[displacement(x) for x,t in unique]})
HeatMesh=rg.Mesh()
for mesh in weave_meshes: HeatMesh.Append(mesh)
# Same 5 mm end widths. The cuffs bridge both woven layers at their anchors.
for start,end in [(0,float(EndBandWidth)),(250-float(EndBandWidth),250)]:
    band=rg.Mesh();segments=256
    for x,h in [(start,-lift-thickness/2),(end,-lift-thickness/2),(start,lift+thickness/2),(end,lift+thickness/2)]:
        radius=35+.108*x+h
        for i in range(segments):
            theta=2*math.pi*i/segments
            band.Vertices.Add(x,radius*math.cos(theta),radius*math.sin(theta))
    for i in range(segments):
        j=(i+1)%segments
        band.Faces.AddFace(i,j,segments+j,segments+i)
        band.Faces.AddFace(2*segments+i,3*segments+i,3*segments+j,2*segments+j)
        band.Faces.AddFace(i,2*segments+i,2*segments+j,j)
        band.Faces.AddFace(segments+i,segments+j,3*segments+j,3*segments+i)
    band.UnifyNormals();band.Normals.ComputeNormals()
    if band.SolidOrientation()<0: band.Flip(True,True,True)
    band.VertexColors.CreateMonotoneMesh(Color.FromArgb(20,30,110))
    weave_meshes.append(band);HeatMesh.Append(band)
HeatMesh.Normals.ComputeNormals();HeatMesh.Compact()
Status='OK | plain weave | 24 closed strips | 96 alternating crossings | lift %.2f mm | thickness %.2f mm' % (lift,thickness)
# ---------- end sensor_heatmap ----------
list_length_2 = ListLength(List=sensorintersections)
panel_3 = Panel(list_length_2)
heatmapmesh = Mesh(sensor_heatmap.HeatMesh)
panel_4 = Panel(sensor_heatmap.Status)
